# Grasshopper definition GHCitySim.ghx (Grasshopper 0.9.76)
# plug-ins: Python Interpreter

toggle = BooleanToggle(False)
importepw = Ladybug_ImportEpw()  # -> readMe, latitude, location, dryBulbTemperature, dewPointTemperature, relativeHumidity, windSpeed, windDirection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; plug-in component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
path = FilePath("C:\Users\peronato\Documents\WeatherFiles\Neuchatel-hour.epw")
panel = Panel("C:\Users\peronato\Desktop\CitySimGH\")
epw_to_clim = Ladybug_EpwToClim(epwFile=path, path=panel, Run=Toggle(False))  # -> out, climatefile; plug-in component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
brep = Brep([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])
debrep = DeconstructBrep(Brep=brep)  # -> simplify(Faces), Edges, Vertices
brep_2 = Brep(graft(debrep.Faces))
citysim_runsimulation = Honeybee_CitySimRunSimulation(geometry=brep_2, path=panel, name="test", Run=Toggle(False), climatefile=epw_to_clim.climatefile)  # -> Out; plug-in component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
citysim_loadresults = Honeybee_CitySimLoadResults(path=panel, name="test")  # -> SW; plug-in component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
ma = MassAddition(Input=citysim_loadresults)  # -> Result, PartialResults
brep_3 = Brep(brep_2)
exportladybug = Ladybug_ExportLadybug(components="*", targetFolder="C:\Users\peronato\Documents\GitHub\GHCitySim", export=Toggle(False))  # -> readMe; plug-in component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
division = Division(A=ma.Result, B=1000)
bnd = Bounds(Numbers=flatten(division))
ladybug = Ladybug_Ladybug()  # -> Vviiiiiiiiiizzz; plug-in component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
honeybee = Honeybee_Honeybee()  # -> Vviiiiiiiiiizzz; plug-in component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
dedomain = DeconstructDomain(Domain=bnd)  # -> Start, End
gradient = Gradient(
    LowerLimit=Slider(0, range=0..100),
    UpperLimit=dedomain.End,
    Parameter=division,
    stops=[0: RGB(0, 0, 255), 0.498: RGB(255, 255, 0), 1: RGB(255, 0, 0)])
preview = CustomPreview(Geometry=brep_3, Shader=gradient)
